# Dynamo graph Dynamic parametric corridor.dyn (Dynamo 2.5.2.7915)
# packages: Tucrail.Dynamo.Civil 1.1.0

# group: Baseline stations from block positions
alignment = StringInput("GI_NB")
current = Autodesk.AutoCAD.DynamoNodes.Document.Current()
alignmentByName = Autodesk.Civil.DynamoNodes.Selection.AlignmentByName(name=alignment, document=current)
block = StringInput("Benchmark")
blockByName = Autodesk.AutoCAD.DynamoNodes.Document.BlockByName(document=current, name=block)
blockReferences = Autodesk.AutoCAD.DynamoNodes.Block.BlockReferences(block=blockByName)
coordinateSystem = Autodesk.AutoCAD.DynamoNodes.BlockReference.CoordinateSystem(blockReference=blockReferences)
origin = CoordinateSystem.Origin(coordinateSystem=coordinateSystem)
stationOffsetByPoint = Autodesk.Civil.DynamoNodes.Alignment.StationOffsetByPoint(alignment=alignmentByName, point=origin)
code_block = CodeBlock(a=stationOffsetByPoint.Station) { a[0]; a[1]; }

# group: Import coordinats to calculate additional stations
file_path = Filename(".\extra points.csv")  # graph input
boolean = BoolSelector(false)
importCSV = Data.ImportCSV(filePath=file_path, transpose=boolean)
code_block_2 = CodeBlock(a=importCSV) { a[0]; a[1]; a[2]; }
byCoordinates = Point.ByCoordinates(x=code_block_2.out0, y=code_block_2.out1, z=code_block_2.out2)
stationOffsetByPoint_2 = Autodesk.Civil.DynamoNodes.Alignment.StationOffsetByPoint(alignment=alignmentByName, point=byCoordinates)

code_block_3 = CodeBlock { ["csv1","csv2","csv3"]; }

# group: BaselineRegion frequency settings
boolean_2 = BoolSelector(true)
curveAtIncrement = Autodesk.Civil.CorridorAlongCurveOption.CurveAtIncrement()
code_block_4 = CodeBlock { [25,10,5,1]; }
integer_slider = IntegerSlider(2, range=0..3 step 1)  # graph input
getItemAtIndex = List.GetItemAtIndex(list=code_block_4, index=integer_slider)
code_block_5 = CodeBlock { 0.1; }
targetCurveAtIncrement = Autodesk.Civil.CorridorAlongOffsetTargetCurveOption.TargetCurveAtIncrement()
create = CivilAppliedAssemblySetting.Create(targetStartEnd=boolean_2, horizontalGeometryPoints=boolean_2, targetGeometryPoints=boolean_2, profileGeometryPoints=boolean_2, profileHighLowPoints=boolean_2, superelevationCriticalPoints=boolean_2, curvesOption=curveAtIncrement, frequencyAlongCurves=getItemAtIndex, frequencyAlongProfileCurves=getItemAtIndex, frequencyAlongSpirals=getItemAtIndex, frequencyAlongTangents=getItemAtIndex, frequencyAlongTargetCurves=getItemAtIndex, modAlongCurves=code_block_5, modAlongTargetCurves=code_block_5, targetCurveOption=targetCurveAtIncrement)

# group: Dynamic baselineregion creation
code_block_6 = CodeBlock { "Corridor - (1)"; "BL - GI_NB - (11)"; "BaselineRegion - (1)"; "Dual_Tunnel"; }
current_2 = Autodesk.AutoCAD.DynamoNodes.Document.Current()
corridorByName = Autodesk.Civil.DynamoNodes.Selection.CorridorByName(name=code_block_6.out0, document=current_2)
baselineByName = Autodesk.Civil.DynamoNodes.Corridor.BaselineByName(corridor=corridorByName, name=code_block_6.out1)
create_2 = CivilBaselineRegion.Create(baseline=baselineByName, regionName=code_block_6.out2, assemblyName=code_block_6.out3, startStation=code_block.out0, endStation=code_block.out1, additionalStations=stationOffsetByPoint_2.Station, additionalStationDescriptions=code_block_3, appliedAssemblySetting=create)

# group: Corridor.Rebuild
code_block_7 = CodeBlock(a=baselineByName, b=create_2) { a; b; }
regions = Autodesk.Civil.DynamoNodes.Baseline.Regions(baseline=code_block_7.a)
code_block_8 = CodeBlock(a=regions, b=code_block_7.b) { a[b]; }
baseline = Autodesk.Civil.DynamoNodes.BaselineRegion.Baseline(baselineRegion=code_block_8)
corridor = Autodesk.Civil.DynamoNodes.Baseline.Corridor(baseline=baseline)
rebuild = Autodesk.Civil.DynamoNodes.Corridor.Rebuild(corridor=corridor)
