# Dynamo graph Dynamic solid from corridor.dyn (Dynamo 2.5.2.7915)

# group: Corridor -> Baseline Stations / Alignment
corridor = StringInput("Corridor - (6)")
current = Autodesk.AutoCAD.DynamoNodes.Document.Current()
corridorByName = Autodesk.Civil.DynamoNodes.Selection.CorridorByName(name=corridor, document=current)
baseline = StringInput("BL - GI_NB - (12)")
baselineByName = Autodesk.Civil.DynamoNodes.Corridor.BaselineByName(corridor=corridorByName, name=baseline)
alignment = Autodesk.Civil.DynamoNodes.Baseline.Alignment(baseline=baselineByName)
stations = Autodesk.Civil.DynamoNodes.Baseline.Stations(baseline=baselineByName)

# group: Rail plinth zone from block positions
block = StringInput("Benchmark")
blockByName = Autodesk.AutoCAD.DynamoNodes.Document.BlockByName(document=current, name=block)
blockReferences = Autodesk.AutoCAD.DynamoNodes.Block.BlockReferences(block=blockByName)
coordinateSystem = Autodesk.AutoCAD.DynamoNodes.BlockReference.CoordinateSystem(blockReference=blockReferences)
origin = CoordinateSystem.Origin(coordinateSystem=coordinateSystem)
stationOffsetByPoint = Autodesk.Civil.DynamoNodes.Alignment.StationOffsetByPoint(alignment=alignment, point=origin)
code_block = CodeBlock(start=stationOffsetByPoint.Station, end=stationOffsetByPoint.Station) { start[0]; end[1]; }

# group: Plinth station creation
plinth_opening = DoubleInput(0.1)  # graph input
plinth_standard_length = DoubleInput(10)  # graph input
plinth_minimum_length = DoubleInput(1)  # graph input
plinth_station_generator = Python(IN[0]=code_block.out0, IN[1]=code_block.out1, IN[2]=plinth_opening, IN[3]=plinth_standard_length, IN[4]=plinth_minimum_length)
# ---------- plinth_station_generator.python (61 lines) ----------
# Load the Python Standard and DesignScript Libraries
import sys
import clr
import math

start = float(IN[0])
end = float(IN[1])

joint = float(IN[2])
console = float(IN[3])
min = float(IN[4])

accuracy = 0.001

i = start
sequence = []

while i < end:  
    i = i + joint
    if(i <= end):
    	sequence.append(i)
 
    i = i + console
    
    if(i <= end):
    	sequence.append(i)
else:
    pass  

if (sequence.Count > 0):

	totalLength = end - start
	
	if (totalLength >= (joint + console)):
	
		last = sequence.Count - 1
		prelast = sequence.Count - 2
		segmentLength = sequence[last] - sequence[prelast]
		restLength = end - sequence[last]
		
		if ((segmentLength - joint) < accuracy):
			
			if (restLength < min):
			
				sequence.pop(prelast)
				sequence.pop(prelast)
				sequence.append(end)
								
			else:
				
				sequence.append(end)
							
		elif ((segmentLength - console) < accuracy):
			sequence.pop(last)
			sequence.append(end)
		
	else:
		sequence.Clear()

# Assign your output to the OUT variable.
OUT = sequence
# ----------------------------------------
digits = DoubleInput(3)
round = Math.Round(number=plinth_station_generator, digits=digits)
start_end = DoubleInput(2)
chop = List.Chop(list=round, lengths=start_end)

# group: Plinth points calculation
alignment_2 = CodeBlock(align=alignment) { align; }
add_corridor_station_to_plinths = Python(IN[0]=chop, IN[1]=stations)
# ---------- add_corridor_station_to_plinths.python (22 lines) ----------
# Load the Python Standard and DesignScript Libraries
import sys
import clr

# The inputs to this node will be stored as a list in the IN variables.
dataEnteringNode = IN

ConsoleList = IN[0]
CorridorList = IN[1]

Consoles = []
for x in ConsoleList:
	Console = []
	Console.Add(x[0])
	for y in CorridorList:
		if x[0] < y < x[1]:
			Console.Add(y)
	Console.Add(x[1])
	Consoles.Add(Console)

# Assign your output to the OUT variable.
OUT = Consoles
# ----------------------------------------
left_outer_offset = DoubleInput(-0.818)  # graph input
left_inner_offset = DoubleInput(-0.618)  # graph input
list_create = List.Create(item0=left_outer_offset, item1=left_inner_offset)
coordinateSystemByStationOffset = Autodesk.Civil.DynamoNodes.Alignment.CoordinateSystemByStationOffset(alignment=alignment_2, station=add_corridor_station_to_plinths@L3, offset=list_create, lacing=Longest)
transpose = List.Transpose(lists=coordinateSystemByStationOffset)
origin_2 = CoordinateSystem.Origin(coordinateSystem=transpose)
right_inner_offset = DoubleInput(0.618)  # graph input
right_outer_offset = DoubleInput(0.818)  # graph input
list_create_2 = List.Create(item0=right_inner_offset, item1=right_outer_offset)
coordinateSystemByStationOffset_2 = Autodesk.Civil.DynamoNodes.Alignment.CoordinateSystemByStationOffset(alignment=alignment_2, station=add_corridor_station_to_plinths@L3, offset=list_create_2, lacing=Longest)
transpose_2 = List.Transpose(lists=coordinateSystemByStationOffset_2)
origin_3 = CoordinateSystem.Origin(coordinateSystem=transpose_2)

# group: Corridor Surface elevation retrieval - Top/Bottom plinth
X = Point.X(point=origin_2@L4)
Y = Point.Y(point=origin_2@L4)
code_block_2 = CodeBlock { ["Corridor - (6) - (1)","Corridor - (6) - (2)"]; }
current_2 = Autodesk.AutoCAD.DynamoNodes.Document.Current()
surfaceByName = Autodesk.Civil.DynamoNodes.Selection.SurfaceByName(name=code_block_2, document=current_2)
code_block_3 = CodeBlock(a=surfaceByName) { a[0]; a[1]; }
elevationByXY = Autodesk.Civil.DynamoNodes.Surface.ElevationByXY(surface=code_block_3.out0, x=X, y=Y, lacing=Longest)
byCoordinates = Point.ByCoordinates(x=X, y=Y, z=elevationByXY)
code_block_4 = CodeBlock { 1; }
flatten = List.Flatten(list=byCoordinates, amt=code_block_4)
elevationByXY_2 = Autodesk.Civil.DynamoNodes.Surface.ElevationByXY(surface=code_block_3.out1, x=X, y=Y, lacing=Longest)
byCoordinates_2 = Point.ByCoordinates(x=X, y=Y, z=elevationByXY_2)
flatten_2 = List.Flatten(list=byCoordinates_2, amt=code_block_4)
group_plinth_points = Python(IN[0]=flatten, IN[1]=flatten_2)
# ---------- group_plinth_points.python (32 lines) ----------
# Load the Python Standard and DesignScript Libraries
import sys
import clr

# The inputs to this node will be stored as a list in the IN variables.
dataEnteringNode = IN

BottomPoints = IN[0]
TopPoints = IN[1]

ConsoleAmount = BottomPoints.Count
Consoles = []

for x in range(ConsoleAmount):
	Sections = []
	BottomLeftSectionPoints = BottomPoints[x][0]
	BottomRightSectionPoints = BottomPoints[x][1]
	TopLeftSectionPoints = TopPoints[x][0]
	TopRightSectionPoints = TopPoints[x][1]
	SectionAmount = BottomLeftSectionPoints.Count
	for y in range(SectionAmount):
		Section = []
		Section.Add(BottomLeftSectionPoints[y])
		Section.Add(BottomRightSectionPoints[y])
		Section.Add(TopRightSectionPoints[y])
		Section.Add(TopLeftSectionPoints[y])
		Section.Add(BottomLeftSectionPoints[y])
		Sections.Add(Section)
	Consoles.Add(Sections)

# Assign your output to the OUT variable.
OUT = Consoles
# ----------------------------------------
X_2 = Point.X(point=origin_3@L4)
Y_2 = Point.Y(point=origin_3@L4)
elevationByXY_3 = Autodesk.Civil.DynamoNodes.Surface.ElevationByXY(surface=code_block_3.out0, x=X_2, y=Y_2, lacing=Longest)
byCoordinates_3 = Point.ByCoordinates(x=X_2, y=Y_2, z=elevationByXY_3)
code_block_5 = CodeBlock { 1; }
flatten_3 = List.Flatten(list=byCoordinates_3, amt=code_block_5)
elevationByXY_4 = Autodesk.Civil.DynamoNodes.Surface.ElevationByXY(surface=code_block_3.out1, x=X_2, y=Y_2, lacing=Longest)
byCoordinates_4 = Point.ByCoordinates(x=X_2, y=Y_2, z=elevationByXY_4)
flatten_4 = List.Flatten(list=byCoordinates_4, amt=code_block_5)
group_plinth_points_2 = Python(IN[0]=flatten_3, IN[1]=flatten_4)  # same code as group_plinth_points

layer = StringInput("Plinth-Polyline")

# group: Solid and 3D polyline creation
current_3 = Autodesk.AutoCAD.DynamoNodes.Document.Current()
modelSpace = Autodesk.AutoCAD.DynamoNodes.Document.ModelSpace(document=current_3)
byPoints = Autodesk.AutoCAD.DynamoNodes.Polyline3D.ByPoints(points=group_plinth_points, layer=layer, block=modelSpace)
byPoints_2 = PolyCurve.ByPoints(points=group_plinth_points)
byLoft = Solid.ByLoft(crossSections=byPoints_2)
layer_2 = StringInput("Plinth-Solid")
byGeometry = Autodesk.AutoCAD.DynamoNodes.Object.ByGeometry(geometry=byLoft, layer=layer_2, block=modelSpace)
byPoints_3 = PolyCurve.ByPoints(points=group_plinth_points_2)
byLoft_2 = Solid.ByLoft(crossSections=byPoints_3)
byGeometry_2 = Autodesk.AutoCAD.DynamoNodes.Object.ByGeometry(geometry=byLoft_2, layer=layer_2, block=modelSpace)
byPoints_4 = Autodesk.AutoCAD.DynamoNodes.Polyline3D.ByPoints(points=group_plinth_points_2, layer=layer, block=modelSpace)
