# Dynamo graph Switch Corridor.dyn (Dynamo 2.5.2.7915)
# packages: Tucrail.Dynamo.AutoCAD 1.0.0, Tucrail.Dynamo.Civil 1.1.0

# group: Retrieve Dynamic Block References by Name [IN] Document/Block Name [OUT] Document/CADDynamicBlock
current = Autodesk.AutoCAD.DynamoNodes.Document.Current()
block_name = CodeBlock { "Switch Data Management"; }
getDynamicBlockReferences = CadDynamicBlock.GetDynamicBlockReferences(document=current, blockName=block_name)
cad_dynamic_block = CodeBlock(CADDynamicBlock_plug=getDynamicBlockReferences) { CADDynamicBlock_plug; }
document = CodeBlock(document_plug=current) { document_plug; }

# group: Retrieve Property Values from Block References [IN] CADDynamicBlock/Property Names [OUT] Properties
cad_dynamic_block_2 = CodeBlock(CADDynamicBlock_plug=cad_dynamic_block) { CADDynamicBlock_plug; }
property_names = CodeBlock { "SwitchName"; "StartStation"; "EndStation"; "Left_Right"; }
getPropertyValue = CadDynamicBlock.GetPropertyValue(dynamicBlock=cad_dynamic_block_2, propertyName=property_names.out0)
getPropertyValue_2 = CadDynamicBlock.GetPropertyValue(dynamicBlock=cad_dynamic_block_2, propertyName=property_names.out1)
getPropertyValue_3 = CadDynamicBlock.GetPropertyValue(dynamicBlock=cad_dynamic_block_2, propertyName=property_names.out2)
getPropertyValue_4 = CadDynamicBlock.GetPropertyValue(dynamicBlock=cad_dynamic_block_2, propertyName=property_names.out3)
block_properties = CodeBlock(Name_plug=getPropertyValue, StartStation_plug=getPropertyValue_2, EndStation_plug=getPropertyValue_3, Left_Right_plug=getPropertyValue_4) { Name_plug; StartStation_plug; EndStation_plug; Left_Right_plug; }

# group: Create Switch Corridor and Baseline [IN] Prefix/Alignment Name/Profile Name/Switch Name/Document [OUT] Corridor/Baseline Name
alignment_name = CodeBlock { "Alignment - (1)"; }
prefix = CodeBlock { "pre_"; }
switch_name = CodeBlock(Name_plug=block_properties.Name_plug) { Name_plug; }
document_2 = CodeBlock(document_plug=document) { document_plug; }
createSwitchCorridor = CivilCorridor.CreateSwitchCorridor(alignmentName=alignment_name, prefix=prefix, switches=switch_name, document=document_2)
name = CivilCorridor.Name(civilCorridor=createSwitchCorridor)
corridorByName = Autodesk.Civil.DynamoNodes.Selection.CorridorByName(name=name, document=document_2)
corridor = CodeBlock(Corridor_plug=corridorByName) { Corridor_plug; }
separator = CodeBlock { " - "; }
profile_name = CodeBlock { "Layout (1)"; }
join = String.Join(separator=separator, string0=alignment_name, string1=profile_name)
alignmentByName = Autodesk.Civil.DynamoNodes.Selection.AlignmentByName(name=alignment_name, document=document_2)
profileByName = Autodesk.Civil.DynamoNodes.Alignment.ProfileByName(alignment=alignmentByName, name=profile_name)
createFromAlignmentAndProfile = CivilBaseline.CreateFromAlignmentAndProfile(baselineName=join, corridor=corridorByName, alignment=alignmentByName, profile=profileByName)
baseline_name = CodeBlock(Baseline_plug=createFromAlignmentAndProfile) { Baseline_plug; }

# group: Create Switch BaselineRegion and update corridor [IN] Corridor/Baseline/Block Properties [OUT] BaselineRegion
corridor_2 = CodeBlock(Corridor_plug=corridor) { Corridor_plug; }
baseline_name_2 = CodeBlock(Baseline_plug=baseline_name) { Baseline_plug; }
baselineByName = Autodesk.Civil.DynamoNodes.Corridor.BaselineByName(corridor=corridor_2, name=baseline_name_2)
block_properties_2 = CodeBlock(Name_plug=block_properties.Name_plug, StartStation_plug=block_properties.StartStation_plug, EndStation_plug=block_properties.EndStation_plug, Left_Right_plug=block_properties.Left_Right_plug) { Name_plug; StartStation_plug; EndStation_plug; Left_Right_plug; }
code_block = CodeBlock { "Assembly - (2)"; "Assembly - (1)"; }
if_ = If(test=block_properties_2.Left_Right_plug, true=code_block.out0, false=code_block.out1)
create = CivilAppliedAssemblySetting.Create()  # unwired: targetStartEnd, horizontalGeometryPoints, targetGeometryPoints, profileGeometryPoints, profileHighLowPoints, superelevationCriticalPoints, curvesOption, frequencyAlongCurves, frequencyAlongProfileCurves, frequencyAlongSpirals, frequencyAlongTangents, frequencyAlongTargetCurves, modAlongCurves, modAlongTargetCurves, targetCurveOption
create_2 = CivilBaselineRegion.Create(baseline=baselineByName, regionName=block_properties_2.Name_plug, assemblyName=if_, startStation=block_properties_2.StartStation_plug, endStation=block_properties_2.EndStation_plug, appliedAssemblySetting=create)  # unwired: additionalStations
code_block_2 = CodeBlock(a=baselineByName, b=create_2) { a; b; }
regions = Autodesk.Civil.DynamoNodes.Baseline.Regions(baseline=code_block_2.a)
code_block_3 = CodeBlock(a=regions, b=code_block_2.b) { a[b]; }
baseline = Autodesk.Civil.DynamoNodes.BaselineRegion.Baseline(baselineRegion=code_block_3)
corridor_3 = Autodesk.Civil.DynamoNodes.Baseline.Corridor(baseline=baseline)
rebuild = Autodesk.Civil.DynamoNodes.Corridor.Rebuild(corridor=corridor_3)
